# Grasshopper definition 10_Rev_Off Axis_Walls.gh (Grasshopper 1.0.8)
# plug-ins: Pufferfish, Rhino.Inside for Autodesk Revit

doubleclick = BooleanToggle(False)
dss_annotation_panel = Panel("Help on WhiteWork")
# Segment
# group modules into larger coherent parts
# User Interface: I/O
dss_log_v5_2 = PythonScript(Help=doubleclick)  # inputs Help: Boolean
# ---------- dss_log_v5_2: Python ----------
"""
Set grasshopper template and provide easy acces to Help file in intranet

"""

"""
Credits:
    20211117
    Created by Vladimir Ondejcik
    White arkitekter AB

Based on:
    WOMBAT version <0.0.1>
    Script by <Brian Ringley>
        def libraries() by <Giulio Piacentino> see <http://www.grasshopper3d.com/forum/topics/gh-filename-is-python>
        def writeToFile() by <Data Analytics Society> see <https://www.youtube.com/watch?v=-TF3mXhnCDw>
    Script version <15 September 2015> 
    Copyright <Creative Commons Sharealike>
"""


#add dsearch default path located on cad.local
import sys
new_path = r"\\sesthfs02\DSEARCH\REPOSITORY\Grasshopper\Xtras\DsearchCode"
if new_path not in sys.path: sys.path.append(new_path)

#import dsearch plugin
import dsearch as ds

import os

print sys.path

#reload module (this has use when working on module)
#reload(ds.DS_Log)
#reload(ds.DS_Links)

#setup template
template=ds.DS_Links.Template
ds.DS_Log.DS_Template(template)

#run help from module 
if Help:
    helpLink=ds.DS_Links.HelpLink
    ds.DS_Log.DS_Help(helpLink)

    #turn toggle back to false
    obj=ghenv.Component.Params.Input[0].Sources[0]
    obj.Value=False
    obj.ExpireSolution(True)
# ---------- end dss_log_v5_2 ----------

dss_projectnumber = Panel("0000")
dss_projectname = Panel("name")

# ----
# Organization of Grasshopper scripts at White:
# Script should be created and annotated always with notion that other person will need to use/edit them.
# Build your script in modules and segments, use color coding and annotation according this template.
# This standard should be applied to all scripts, big or small.
# 
# Read  guide on white work:
# "https://work.white.se/grasshopper-developer-guide/"
# For Advanced users:
# For design scripts running more than a month use "dsInitialize" and "dsScriptLog" functions on Dsearch tab to log changes over time.
dss_annotation_panel_2 = Panel("""Tip of a day:
You can change default colour grups by right clicking
Graphical templates are located on "Dsearch" tab""")
# GRAPHIC
# STANDARD
# In
# data and geometry import from rhino or external platforms
image = ImageSampler(dss_annotation_panel_2, Filter="Colour", Interpolate=False, Umax=1, Umin=0, Vmax=1, Vmin=0, Wrap=0)

grids = QueryGrids()

# ---- group: Active view
a_view = ActiveView()

# ---- group: Query Walls
categories = QueryCategories(Type=1, Name="Walls", IsVisibleUI=True, IsSubcategory=False)
visible_in_view_filter = VisibleInViewFilter(View=a_view, Inverted=False)
v_elements = QueryViewElements(View=a_view, Categories=categories, Filter=visible_in_view_filter)

# ---- group: Create filled region type
categories_2 = QueryCategories(Type=1, Name="Detail Items", IsVisibleUI=True, IsSubcategory=False)
types = QueryTypes(Kind=3, Category=categories_2)
match_text = MatchText(Text=types, RegEx="Solid", Case=True)
cull_pattern = CullPattern(List=types, CullPattern=match_text)
list_length = ListLength(List=cull_pattern)
list_item = ListItem(List=types, Index=Slider(2, range=0..10), Wrap=True)
list_item_2 = ListItem(List=cull_pattern, Index=0, Wrap=True)
boolean = Boolean(list_length)
stream_filter = StreamFilter(Gate=boolean, Stream0=list_item, Stream1=list_item_2)
panel = Panel("Filled Region_RiR")

# ----
# Control
# General
# Monitor
# Out
# variable parameters and script execution
# (sliders, boolean togggle, text input,...)
# monitor data and geometry preview (used for panels for example)
# output data to rhino or external platforms
# WIP
# Annotation
# Plugin
# general annotation and notes
# textbased scripting and special plugins
# f.ex: HumanUI, kangaroo,...
# problematic or under repair or construction
# Back-end
# Rotates curve according to closest near pararell gridline - moves hosted elements a little....
dss_annotation_panel_3 = Panel("general development modules")

active_selection = GraphicalElement(v_elements)
line = Line(active_selection)
null_item = NullItem(Item=line)  # -> NullFlags, InvalidFlags, Description
line_2 = Line(grids)
cull_pattern_2 = CullPattern(List=active_selection, CullPattern=invert(null_item.NullFlags))
graphical_element = GraphicalElement(simplify(graft(cull_pattern_2)))

# ---- group: Create filled region type
panel_2 = Panel("Filled Region_RiR_2")
duplicate = DuplicateType(TypeName=panel, Type=stream_filter, FailureProcessingMode=1, TrackingMode=2)

# ----
vector = Vector(unitize(line_2))
vector_2 = Vector(vector)
line_3 = Line(graphical_element)
vector_3 = Vector(unitize(vector_2))
negative = Negative(Value=vector_3)
vector_4 = Vector(unitize(line_3))
create_set = CreateSet(List=flatten([negative, vector_3]))  # -> Set, Map
set_difference = SetDifference(SetA=simplify(graft(vector_4)), SetB=create_set.Set)  # -> simplify(Union)
list_length_2 = ListLength(List=set_difference)
boolean_2 = Boolean(list_length_2)
cull_pattern_3 = CullPattern(List=graphical_element, CullPattern=boolean_2)

# ---- group: Create filled region type
fill_patterns = QueryFillPatterns(Type=0)
match_text_2 = MatchText(Text=fill_patterns, RegEx="Solid", Case=True)
cull_pattern_4 = CullPattern(List=fill_patterns, CullPattern=match_text_2)
query_element_parameters = QueryElementParameters(Element=duplicate, Name="Foreground Fill Pattern")
list_item_3 = ListItem(List=cull_pattern_4, Index=0, Wrap=True)
param = ElementParameter(Element=duplicate, Parameter=query_element_parameters, Value=list_item_3)  # -> Element, Value

query_element_parameters_2 = QueryElementParameters(Element=duplicate, Name="Foreground Pattern Color")
colour = Colour(ColourSwatch(SwatchColor=RGB(255, 0, 0)))
param_2 = ElementParameter(Element=duplicate, Parameter=query_element_parameters_2, Value=colour)  # -> Element, Value

# ----
line_4 = Line(cull_pattern_3)
vector_5 = Vector(unitize(vector))
vector_6 = Vector(line_4)
dot_product = DotProduct(VectorA=unitize(vector_6), VectorB=unitize(flatten(vector_5)), Unitize=False)
absolute = Absolute(Value=dot_product)
subtraction = Subtraction(A=absolute, B="1")
absolute_2 = Absolute(Value=subtraction)
sort_list = SortList(Keys=absolute_2, ValuesValuesA=vector_5)  # -> Keys, simplify(ValuesValuesA)
list_item_4 = ListItem(List=sort_list.ValuesValuesA, Index=0, Wrap=True)  # -> simplify(Item)
panel_3 = Panel(list_item_4)

# ---- group: Needs to be rotated
clean_tree = CleanTree(RemoveNulls=True, RemoveInvalid=True, RemoveEmpty=True, Tree=cull_pattern_3, SynchronousTree1=list_item_4)  # -> Tree, SynchronousTree1
graphical_element_2 = GraphicalElement(clean_tree.Tree)
unit_z = UnitZ(Factor=1)

line_5 = Line(clean_tree.Tree)
vector_7 = Vector(clean_tree.SynchronousTree1)
vector_8 = Vector(line_5)
negative_2 = Negative(Value=vector_7)
angle = Angle(VectorA=vector_8, VectorB=negative_2)  # -> Angle, Reflex
angle_2 = Angle(VectorA=vector_8, VectorB=vector_7)  # -> Angle, Reflex
degrees = Degrees(Radians=[angle_2.Angle, angle.Angle, angle_2.Reflex, angle.Reflex])
sort_list_2 = SortList(Keys=degrees)  # -> Keys, ValuesValuesA
list_item_5 = ListItem(List=sort_list_2.Keys, Index=0, Wrap=True)
larger_than = LargerThan(FirstNumber=list_item_5, SecondNumber="1")  # -> LargerThan, OrEqualTo

cull_pattern_5 = CullPattern(List=graphical_element_2, CullPattern=invert(larger_than.LargerThan))
clean_tree_2 = CleanTree(RemoveNulls=True, RemoveInvalid=True, RemoveEmpty=True, Tree=cull_pattern_5)
line_6 = Line(clean_tree_2)
vector_9 = Vector(line_6)
cross_product = CrossProduct(VectorA=vector_9, VectorB=unit_z, Unitize=False)  # -> Vector, Length
curve_middle = CurveMiddle(Curve=line_6)
construct_plane = ConstructPlane(Origin=curve_middle, XAxis=unitize(line_6), YAxis=unitize(cross_product.Vector))
bounding_rectangle = BoundingRectangle(Geometry=clean_tree_2, Plane=construct_plane, Axis=0, Slide=0, Union=True)  # -> Bounding, DimensionX, DimensionY
scale_nu = ScaleNU(Geometry=bounding_rectangle.Bounding, Plane=construct_plane, ScaleX=1, ScaleY=Slider(0.6, range=0..1), ScaleZ=1)  # -> Geometry, Transform
region = AddRegion(View=a_view, Boundary=simplify(scale_nu.Geometry), Type=param_2.Element)

selelems = SelectElement(Element=clean_tree_2, Selected=Toggle(True))  # -> Element, Selected
